# Requirement set stakeholderRequirements (R2023a)

## 1 [#1] Flight maneuver
The drone shall be able to perform take off and landing vertically.

## 2 [#12] Package
The drone can carry a package with a mass of at least 10 grams.

## 3 [#13] Package
The drone can attach and release a package without human intervention.

## 4 [#2] Maneuverability
The drone should be able to move freely in all 6 directions.

## 5 [#3] Maneuverability
The drone can freely rotate along the Z-axis whilst stationery.

## 6 [#4] Control
The drone can be controlled remotely.

## 7 [#5] Control
The drone can be controlled autonomously.

### 7.1 [#10] Autonomy
Whilst flying autonously, the drone can avoid obstacles.

### 7.2 [#15] Landing accuracy
The drone can land autonomously with an accuracy of 1 meter.

## 8 [#7] Performance
The drone can fly at a height of at least 2 meters.

## 9 [#8] Communication
The drone can send telemetry to a remote controller.

## 10 [#9] Performance
The drone shall have a flight range of at least 10 meters.

## 11 [#11] Communication
The drone can remain in contact with the remote controller at an unobstructed distance of at least 10 meters.

## 12 [#14] Safety
The drone can autonously shut down when dangerous conditions are sensed.

## 13 [#16] Drone platform
The For The Win Robotics Parrot Mambo drone has to be used.